# Grasshopper definition ar_material.gh (Grasshopper 1.0.7)

pt = Point(Point(3.732519522, 2.668289467, 0))
py = GhPythonScript(name="ar_scene.json")  # -> filename
# ---------- py: Python ----------
import os
filename = ghenv.Component.OnPingDocument().FilePath
filepath = os.path.dirname(filename)
filename = os.path.join(filepath, name)
# ---------- end py ----------
python = GhPythonScript(color=ColourSwatch(SwatchColor=RGB(109, 163, 144)), name="mat")  # -> material
# ---------- python: Python ----------
from compas_xr.datastructures import Material
from compas_xr.datastructures.material import PBRMetallicRoughness

color = color.R/255., color.G/255., color.B/255., color.A/255.

print color

material = Material()
material.name = name
material.double_sided = True
material.pbr_metallic_roughness = PBRMetallicRoughness()
material.pbr_metallic_roughness.base_color_factor = list(color)
material.pbr_metallic_roughness.metallic_factor = 0.0
material.pbr_metallic_roughness.roughness_factor = 0.5
# ---------- end python ----------
python_2 = GhPythonScript(attrPt=pt, scale=Slider(0.05, range=0..0.1), rangex=Slider(10, range=0..10))  # -> C, L, S; inputs attrPt: list
# ---------- python_2: Python ----------
import Rhino.Geometry as rg

P = []
for i in range(10):
    for j in range(10):
        P.append(rg.Point3d(i,j,0))

C = []
L = []
S = []

for p in P:
    
    distance = 0
    vector = rg.Vector3d(0,0,0)
    for a in attrPt:
        d = p.DistanceTo(a)
        if d < rangex: 
            distance += d
            v = (p - a)
            vector += v
    c = rg.Circle(rg.Plane(p, rg.Vector3d.XAxis, rg.Vector3d.YAxis), distance/20)
    if c.IsValid:
        p, radius = c.Center, c.Radius
        sphere = rg.Sphere(p, radius)
        S.append(sphere)
    C.append(c)
    L.append(rg.Line(p - vector * scale, p + vector * scale))
# ---------- end python_2 ----------
python_3 = GhPythonScript(paths="C:\Users\rustr\workspace\compas_xr\src", y=Button())  # -> out, a; inputs paths: list
# ---------- python_3: Python ----------
import sys

for path in paths:
    sys.path.append(path)
# ---------- end python_3 ----------
python_4 = GhPythonScript(S=python_2.S, material=python, filename=py, export=Toggle(False))  # -> out, scene; inputs S: list of Surface
# ---------- python_4: Python ----------
import sys
sys.path.append(r"C:\Users\rustr\workspace\compas_xr\src")
from compas_xr.datastructures import Scene
from compas.geometry import Sphere
import Rhino.Geometry as rg


scene = Scene()
world = scene.add_layer("world")
materials_map = {}
mkey = scene.add_material(material)
materials_map[material.name] = mkey

for i, s in enumerate(S):
    s = s.TryGetSphere()[1]
    sphere = Sphere(s.Center, s.Radius)
    key = scene.add_layer("s%i" % i, element=sphere, parent="world", material=materials_map["mat"])

gltffile = filename.replace(".json", ".gltf")
scene.to_gltf(filename.replace(".json", ".gltf"))

if export:
    import os
    cmd = r"C:\Users\rustr\AppData\Local\usdzconvert_webui\instance\converter\pxr_usd_abc1710_py27_win64\run_usdzconvert.cmd"
    cmdstr = '%s "%s"' % (cmd, gltffile)
    os.system(cmdstr)
    #scene.to_json(filename)
# ---------- end python_4 ----------
