# Grasshopper definition ar_to_web.gh (Grasshopper 1.0.7)

brep = Brep(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)
python = GhPythonScript()  # -> out, a
# ---------- python: Python ----------
import sys
from compas_rhino import unload_modules

unload_modules("compas_xr")

sys.path.append(r"C:\Users\rustr\workspace\compas_xr\src")
import compas_xr
# ---------- end python ----------
mesh = Mesh(brep)
python_2 = GhPythonScript(mesh=mesh, color=ColourSwatch(SwatchColor=RGB(58, 153, 134)))  # -> gltf_filepath
# ---------- python_2: Python ----------
import os
import compas
from compas.geometry import Scale, Transformation, Frame
from compas.datastructures import Mesh
from compas_xr.datastructures import Scene
from compas_xr.datastructures import Material
from compas_xr.datastructures import PBRMetallicRoughness
from compas_xr import DATA

from compas_rhino.conversions import RhinoMesh


mesh = RhinoMesh.from_geometry(mesh)
cmesh = mesh.to_compas()

# 1. create GLTF
gltf_filepath = os.path.join(DATA, "mesh_with_material.gltf")
bin_filepath = gltf_filepath.replace(".gltf", ".bin")
webAR_template = os.path.join(DATA, "webAR_template.html")

htmlpage = "webAR_000.html"

color = (color.R/255, color.G/255, color.B/255)

material = Material()
material.name = "Plaster"
material.double_sided = True
material.pbr_metallic_roughness = PBRMetallicRoughness()
material.pbr_metallic_roughness.base_color_factor = list(color) + [1.0]
material.pbr_metallic_roughness.metallic_factor = 0.0
material.pbr_metallic_roughness.roughness_factor = 0.5

scene = Scene()
world = scene.add_layer("world")
mkey = scene.add_material(material)

T = Transformation.from_frame_to_frame(Frame.worldXY(), Frame.worldZX())

cmesh.transform(T)


scene.add_layer("element", parent=world, element=cmesh, material=mkey)
scene.to_gltf(gltf_filepath, embed_data=False)

print gltf_filepath
# ---------- end python_2 ----------
info = Info()  # -> info
#   port info: Environment info.
# ---------- info: Python ----------
"""
Displays information about the active COMPAS environment.
"""
import compas_bootstrapper
from ghpythonlib.componentbase import executingcomponent as component

import compas


class CompasInfo(component):
    def RunScript(self):
        self.Message = 'COMPAS v{}'.format(compas.__version__)
        info = 'COMPAS Version: {}\nEnvironment: {}'
        return (info.format(compas.__version__, compas_bootstrapper.ENVIRONMENT_NAME))
# ---------- end info ----------
panel = Panel(info)
ar = GhPythonScript(gltf_filepath=python_2, upload=Toggle(False))  # -> out, a
# ---------- ar: Python ----------
# Access numpy from Rhino
from compas.rpc import Proxy

if upload:

    compas_xr = Proxy('compas_xr.examples')
    action = compas_xr.upload_to_idl(gltf_filepath)
    compas_xr.stop_server()
# ---------- end ar ----------
vr = GhPythonScript(gltf_filepath=python_2, upload=Toggle(True))  # -> out, a
# ---------- vr: Python ----------
# Access numpy from Rhino
from compas.rpc import Proxy

if upload:
    compas_xr = Proxy('compas_xr.examples')
    action = compas_xr.upload_to_idl_vr(gltf_filepath)
    compas_xr.stop_server()
# ---------- end vr ----------
python_3 = GhPythonScript()  # -> Out, A
