# Grasshopper definition connect_omni.ghx (Grasshopper 1.0.7)

pt = Point(Point(3.732519522, 2.668289467, 0))
python = GhPythonScript(attrPt=pt, scale=Slider(0.05, range=0..0.1), rangex=Slider(10, range=0..10))  # -> C, L, S; inputs attrPt: list
# ---------- python: Python ----------
import Rhino.Geometry as rg

P = []
for i in range(10):
    for j in range(10):
        P.append(rg.Point3d(i,j,0))

C = []
L = []
S = []

for p in P:
    
    distance = 0
    vector = rg.Vector3d(0,0,0)
    for a in attrPt:
        d = p.DistanceTo(a)
        if d < rangex: 
            distance += d
            v = (p - a)
            vector += v
    c = rg.Circle(rg.Plane(p, rg.Vector3d.XAxis, rg.Vector3d.YAxis), distance/20)
    if c.IsValid:
        p, radius = c.Center, c.Radius
        sphere = rg.Sphere(p, radius)
        S.append(sphere)
    C.append(c)
    L.append(rg.Line(p - vector * scale, p + vector * scale))
# ---------- end python ----------
python_2 = GhPythonScript(name="scene.json")  # -> out, filename
# ---------- python_2: Python ----------
import os
filename = ghenv.Component.OnPingDocument().FilePath
filepath = os.path.dirname(filename)
filename = os.path.join(filepath, name)
# ---------- end python_2 ----------
py = GhPythonScript(name="spheres.json")  # -> filename; same code as python_2
python_3 = GhPythonScript(S=python.S, filename=python_2.filename)  # -> out, scene; inputs S: list of Surface
# ---------- python_3: Python ----------
import sys
sys.path.append(r"C:\Users\rustr\workspace\compas_xr\src")
from compas_xr.datastructures import Scene
from compas.geometry import Sphere
import Rhino.Geometry as rg


scene = Scene()
world = scene.add_layer("world")

for i, s in enumerate(S):
    s = s.TryGetSphere()[1]
    sphere = Sphere(s.Center, s.Radius)
    key = scene.add_layer("s%i" % i, element=sphere, parent="world")

scene.to_json(filename)
# ---------- end python_3 ----------
py_2 = GhPythonScript(S=python.S)  # -> spheres; inputs S: list of Surface
# ---------- py_2: Python ----------
import Rhino.Geometry as rg
from compas.geometry import Sphere

spheres = []
for i, s in enumerate(S):
    s = s.TryGetSphere()[1]
    sphere = Sphere(s.Center, s.Radius)
    spheres.append(sphere)
# ---------- end py_2 ----------
python_4 = GhPythonScript(ok=Button(), execute=Toggle(True))  # -> out, a
# ---------- python_4: Python ----------
import os

if execute and ok:
    os.system("C:\\Users\\rustr\\AppData\\Local\\ov\\pkg\\create-2022.1.1\\kit\\kit.exe --empty --enable omni.client --enable omni.usd --exec C:\\Users\\rustr\\workspace\\compas_xr\\grasshopper\\connect.py")
# ---------- end python_4 ----------
to_json = ToJSON(data=py_2, filepath=py)  # -> json; inputs data: list, pretty: Boolean
#   port data: COMPAS data objects to serialize.
#   port filepath: File path where to store the JSON file. If empty, it will not store to disk but instead return the JSON string.
#   port pretty: If True, JSON data will be formatted with indentation and key sorting.
#   port json: JSON file path or JSON string.
# ---------- to_json: Python ----------
"""
Serializes COMPAS objects to JSON.
"""
from ghpythonlib.componentbase import executingcomponent as component

import compas


class CompasInfo(component):
    def RunScript(self, data, filepath, pretty):
        json = filepath

        if filepath:
            compas.json_dump(data, filepath, pretty)
        else:
            json = compas.json_dumps(data, pretty)

        return json
# ---------- end to_json ----------
panel = Panel(python_2.filename)
