# Grasshopper definition testing.ghx (Grasshopper 1.0.7)

info = Info()  # -> info
#   port info: Environment info.
# ---------- info: Python ----------
"""
Displays information about the active COMPAS environment.
"""
import compas_bootstrapper
from ghpythonlib.componentbase import executingcomponent as component

import compas


class CompasInfo(component):
    def RunScript(self):
        self.Message = "COMPAS v{}".format(compas.__version__)
        info = "COMPAS Version: {}\nEnvironment: {}"
        return info.format(compas.__version__, compas_bootstrapper.ENVIRONMENT_NAME)
# ---------- end info ----------
panel = Panel(info)
data = Data("X:\GKR_working\Fall_2023\git_working\compas_xr")
init_to_firebase = GhPythonScript(path=data, connect=Toggle(False))  # -> out, a; inputs connect: Boolean
# ---------- init_to_firebase: Python ----------
import os
from compas.rpc import Proxy


canvas = ghenv.Component.OnPingDocument()
folder = os.path.dirname(canvas.FilePath)

if not config_filename:
    default_filename = os.path.join(folder, "firebase_config.json")
    config_filename = None
    print (default_filename)
    print (config_filename)

if config_filename:
    default_filename = None
    config_filename = os.path.join(folder, config_filename)

if connect:
    with Proxy('compas_xr.storage', path=path+'\src') as storage:
        x = storage.Storage(default_filename, config_filename)
#    proxy_storage = Proxy(package='compas_xr.storage.Storage', path=path +'\src')
#    proxy_storage.stop_server()
#    proxy_storage.start_server()
#    print (proxy_storage)
    
#    proxy_realtime_database = Proxy(package='compas_xr.realtime_database', path=path +'\src')
#    proxy_realtime_database.stop_server()
#    proxy_realtime_database.start_server()
#    print (proxy_realtime_database)
    
    
#    if not os.path.exists(default_filename):
#        raise Exception("Configuration file not found: {}".format(default_filename))
    
#    if not os.path.exists(config_filename):
#        raise Exception("Configuration file not found: {}".format(config_filename))
    
#    storage = proxy_storage.foo()
#    realtime_database = proxy_realtime_database.RealtimeDatabase(default_filename, config_filename)
# ---------- end init_to_firebase ----------
ghpython_script = GhPythonScript(x=data)  # -> out, a
# ---------- ghpython_script: Python ----------
from compas.rpc import Proxy

xr = Proxy(package = "compas_xr.storage", path = x + "\src")
xr.stop_server()
xr.start_server()

a = xr.HERE

print type(xr.__all__)
# ---------- end ghpython_script ----------
