# Grasshopper definition camera.gh (Grasshopper 1.0.7)
# plug-ins: COMPAS FAB

number_slider = Slider(269, range=0..360)
domain = Domain(Domain(0, 360))
python = GhPythonScript(domain=domain, increment=Slider(11.3, range=0.5..20), start=Button(), stop=Button(), reset=Button(), loop=Toggle(True))  # -> out, number
# ---------- python: Python ----------
from scriptcontext import sticky as st
from compas_fab.ghpython.components import create_id
from compas_ghpython import update_component

counter_key = create_id(ghenv.Component, 'counter')
running_key = create_id(ghenv.Component, 'running')

start_value, stop_value = domain

if counter_key not in st or reset:
    st[counter_key] = start_value
    st[running_key] = False

if start: 
    st[running_key] = True

if stop: 
    st[running_key] = False

if st[running_key]:
    if st[counter_key] < stop_value:
        st[counter_key] += increment
        update_component(ghenv, 1)
    else:
        if loop:
            st[counter_key] -= stop_value
            update_component(ghenv, 1)
        else:
            st[running_key] = False

number = st[counter_key]
# ---------- end python ----------
bbox = BoundingBox(Content=[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], Plane=PlaneXY(0, 0, 0), UnionBox=True)  # -> Box, Box_2
panel = Panel(python.number)
number_slider_2 = Slider(49, range=0..100)
number_slider_3 = Slider(1.6, range=0..10)
rad = Radians(Degrees=python.number)
py = GhPythonScript(B=bbox.Box_2)  # -> center
# ---------- py: Python ----------
center = B.Center
# ---------- end py ----------
py_2 = GhPythonScript(name="UserCamera")  # -> view
# ---------- py_2: Python ----------
import Rhino
import scriptcontext

def view_by_name(name=None):
    if name is None: scriptcontext.doc.Views.ActiveView
    for view in scriptcontext.doc.Views.GetViewList(True, True):
        if view.MainViewport.Name == name:
            return view

view = view_by_name(name)
# ---------- end py_2 ----------
python_2 = GhPythonScript(view=py_2, target=py, angle=rad, radius=number_slider_2, z=number_slider_3)  # -> out, a; inputs target: Point3d
# ---------- python_2: Python ----------
import Rhino
import scriptcontext
import Rhino.Geometry as rg
import math

viewport = view.ActiveViewport

#

new_location = viewport.CameraLocation

viewport.SetCameraLocations(target, new_location)
# ---------- end python_2 ----------
python_3 = GhPythonScript(view=py_2, target=py, angle=rad, radius=number_slider_2, z=number_slider_3)  # -> out, a, viewport; inputs target: Point3d
# ---------- python_3: Python ----------
import Rhino
import scriptcontext
import Rhino.Geometry as rg
import math

viewport = view.ActiveViewport

center = rg.Point3d(target)
center.Z = 0

x = math.cos(angle) * radius
y = math.sin(angle) * radius

new_location = center + rg.Vector3d.XAxis * x + rg.Vector3d.YAxis * y
new_location.Z = z
a = new_location
print new_location

viewport.SetCameraLocations(target, new_location)



#import rhinoscriptsyntax as rs
#rs.RotateCamera( angle=-15 )
      
"""
if direction==0 or direction==2: angle=-angle
if direction==0 or direction==1:
    if Rhino.ApplicationSettings.ViewSettings.RotateToView:
        axis = viewport.CameraY
    else:
        axis = Rhino.Geometry.Vector3d.ZAxis
elif direction==2 or direction==3:
    axis = viewport.CameraX
else:
    return False
if Rhino.ApplicationSettings.ViewSettings.RotateReverseKeyboard: angle=-angle
rot = Rhino.Geometry.Transform.Rotation(angle, axis, Rhino.Geometry.Point3d.Origin)
camUp = rot * viewport.CameraY
camDir = -(rot * viewport.CameraZ)
target = viewport.CameraLocation + target_distance*camDir
viewport.SetCameraLocations(target, viewport.CameraLocation)
viewport.CameraUp = camUp
view.Redraw()
return True
"""
# ---------- end python_3 ----------
ros_connect = ROSConnect(Connect=Button())  # -> Ros_client, Is_connected
python_4 = GhPythonScript(client=ros_connect.Ros_client)  # -> topic
# ---------- python_4: Python ----------
from roslibpy import Topic

topic = Topic(client, '/camera_position', 'geometry_msgs/PoseStamped')
topic.advertise()
# ---------- end python_4 ----------
python_5 = GhPythonScript(topic=python_4, viewport=python_3.viewport)  # -> out, a, b, xaxis, c
# ---------- python_5: Python ----------
from compas_fab.backends.ros.messages import Pose, PoseStamped
from compas.geometry import Transformation, Frame
import Rhino.Geometry as rg

a = viewport.CameraLocation
b = viewport.CameraDirection

print viewport.CameraDirection

#zaxis = 
xaxis = rg.Vector3d.CrossProduct(viewport.CameraUp, viewport.CameraDirection)
yaxis = rg.Vector3d.CrossProduct(viewport.CameraDirection, xaxis)
print rg.Vector3d.CrossProduct(rg.Vector3d.YAxis, rg.Vector3d.ZAxis)
print rg.Vector3d.CrossProduct(rg.Vector3d.ZAxis, rg.Vector3d.XAxis)

frame = Frame(viewport.CameraLocation, xaxis, yaxis)
pose_msg = Pose.from_frame(frame)
pose_stamped_msg = PoseStamped(pose=pose_msg)
topic.publish(pose_stamped_msg.msg)
# ---------- end python_5 ----------
vdis = VectorDisplay(Anchor=python_5.a, Vector=python_5.b)
vdis_2 = VectorDisplay(Anchor=python_5.a, Vector=python_5.xaxis)
panel_2 = Panel(ros_connect.Is_connected)
