# Grasshopper definition controller_input.ghx (Grasshopper 1.0.7)
# plug-ins: COMPAS FAB

# ---- group: ROS client
# 1. roslaunch rosbridge_server rosbridge_websocket.launch
# 2. python controller_input_to_ros.py
# 3. GH: connect to ROS
button = Button()
ros_connect = ROSConnect(Connect=button, Disconnect=Button())  # -> Ros_client, Is_connected
panel = Panel(ros_connect.Is_connected)

# ---- group: subscibe button
ros_client = Data(ros_connect.Ros_client)
py = GhPythonScript(prefix="button", controller_name="controller_left")  # -> topic_name
# ---------- py: Python ----------
topic_name = "%s_%s" % (prefix, controller_name)
# ---------- end py ----------
py_2 = GhPythonScript(prefix="button", controller_name="controller_right")  # -> topic_name; same code as py
subscribe = GhPythonScript(ros_client=ros_client, topic_name=py, msg_type="std_msgs/String")
# ---------- subscribe: Python ----------
import scriptcontext as sc

import time
import roslibpy

topic_key = '{}_{}'.format(topic_name, ghenv.Component.InstanceGuid)
topic_instance = sc.sticky.get(topic_key, None)

if ros_client and ros_client.is_connected:

    if topic_instance and topic_instance.is_subscribed:
        print('Unsubscribing old topic...')
        topic_instance.unsubscribe()
        time.sleep(0.2)

    def topic_callback(msg):
        sc.sticky[topic_name] = msg

    topic_instance = roslibpy.Topic(ros_client, '/%s' % topic_name, msg_type)
    topic_instance.subscribe(topic_callback)
    print('Subscribed to topic.')

    sc.sticky[topic_key] = topic_instance
# ---------- end subscribe ----------
subscribe_2 = GhPythonScript(ros_client=ros_client, topic_name=py_2, msg_type="std_msgs/String")  # same code as subscribe

# ---- group: subscribe position
panel_2 = Panel("geometry_msgs/PoseStamped")
ros_client_2 = Data(ros_connect.Ros_client)
py_3 = GhPythonScript(prefix="position", controller_name="controller_left")  # -> topic_name; same code as py
py_4 = GhPythonScript(prefix="position", controller_name="controller_right")  # -> topic_name; same code as py
py_5 = GhPythonScript(prefix="position", controller_name="generic_hmd")  # -> topic_name; same code as py
subscribe_3 = GhPythonScript(ros_client=ros_client_2, topic_name=py_3, msg_type=panel_2)  # same code as subscribe
subscribe_4 = GhPythonScript(ros_client=ros_client_2, topic_name=py_4, msg_type=panel_2)  # same code as subscribe
subscribe_5 = GhPythonScript(ros_client=ros_client_2, topic_name=py_5, msg_type=panel_2)  # same code as subscribe

# ----
panel_3 = Panel(py_2)
panel_4 = Panel(py_3)
panel_5 = Panel(py)
panel_6 = Panel(py_4)
panel_7 = Panel(py_5)
timer = Timer(TimerInterval=1, Target=[current_3, current_4, current, current_2, current_5])

current = GhPythonScript(topic_name=py)  # -> action
# ---------- current: Python ----------
import scriptcontext as sc
from compas_fab.backends.ros.messages import PoseStamped

msg = sc.sticky.get(topic_name)
action = msg["data"]
# ---------- end current ----------
current_2 = GhPythonScript(topic_name=py_2)  # -> action
# ---------- current_2: Python ----------
import scriptcontext as sc
from compas_fab.backends.ros.messages import PoseStamped

msg = sc.sticky.get(topic_name)
print msg
action = msg["data"]
# ---------- end current_2 ----------

current_3 = GhPythonScript(topic_name=py_3)  # -> frame
# ---------- current_3: Python ----------
import scriptcontext as sc
from compas_fab.backends.ros.messages import PoseStamped

msg = sc.sticky.get(topic_name)
print(msg)
frame = PoseStamped.from_msg(msg).pose.frame

print(frame)
# ---------- end current_3 ----------
current_4 = GhPythonScript(topic_name=py_4)  # -> frame
# ---------- current_4: Python ----------
import scriptcontext as sc
from compas_fab.backends.ros.messages import PoseStamped

msg = sc.sticky.get(topic_name)
frame = PoseStamped.from_msg(msg).pose.frame

print(frame)
# ---------- end current_4 ----------
current_5 = GhPythonScript(topic_name=py_5)  # -> frame; same code as current_4

panel_8 = Panel(current)
T = GhPythonScript(frame=current_3)  # -> frame
# ---------- T: Python ----------
from compas.geometry import Frame, Transformation

F = Frame((0,0,0), (1, 0, 0), (0,0,-1))
print F.zaxis

T = Frame((0,0,0), (1, 0, 0), (0,1,0))

frame = frame.transformed(Transformation.from_frame_to_frame(F, T))
# ---------- end T ----------
T_2 = GhPythonScript(frame=current_4)  # -> frame; same code as T
T_3 = GhPythonScript(frame=current_5)  # -> frame; same code as T
panel_9 = Panel(current_2)
draw = GhPythonScript(frames=T_3, scale=Slider(0.1, range=0..1))  # -> P, V, C, W; inputs frames: list
# ---------- draw: Python ----------
from System.Drawing import Color
from compas_ghpython.utilities import draw_frame

red = Color.FromArgb(255, 0, 0)
green = Color.FromArgb(0, 255, 0)
blue = Color.FromArgb(0, 0, 255)

P = []
V = []
C = []

scale = float(scale)

for frame in frames:
    if not frame:
        continue
    plane = draw_frame(frame)
    P += [plane.Origin] * 3
    V.append(plane.XAxis * scale)
    V.append(plane.YAxis * scale)
    V.append(plane.ZAxis * scale)
    C += [red, green, blue]

W = 3
# ---------- end draw ----------
python = GhPythonScript(f1=T, f2=T_2)  # -> out, distance, d
# ---------- python: Python ----------
distance = (f1.point - f2.point).length
import Rhino.Geometry as rg

d = rg.Interval(f1.point.x, f2.point.x)
# ---------- end python ----------
draw_2 = GhPythonScript(frames=T_2, scale=Slider(0.1, range=0..1))  # -> P, V, C, W; inputs frames: list; same code as draw
draw_3 = GhPythonScript(frames=T, scale=Slider(0.1, range=0..1))  # -> P, V, C, W; inputs frames: list; same code as draw
vdisex = VectorDisplayEx(Point=draw.P, Vector=draw.V, Colour=draw.C, Width=draw.W)
vdisex_2 = VectorDisplayEx(Point=draw_2.P, Vector=draw_2.V, Colour=draw_2.C, Width=draw_2.W)
vdisex_3 = VectorDisplayEx(Point=draw_3.P, Vector=draw_3.V, Colour=draw_3.C, Width=draw_3.W)
rectangle = Rectangle(Plane=PlaneXY(0, 0, 0), XSize=python.d, YSize=Slider(1, range=0..1), Radius=0)  # -> Rectangle, Length
boxrec = BoxRectangle(Rectangle=rectangle.Rectangle, Height=Slider(1, range=0..1))
