# Grasshopper definition update_scene.ghx (Grasshopper 1.0.7)
# plug-ins: COMPAS FAB

ros_connect = ROSConnect(Connect=Button())  # -> Ros_client, Is_connected

pt = Point(Point(-345.5536157, 82.41466882, 817.7869288))
pt_2 = Point(Point(-24.58368012, 0.07607440464, 435.9623421))
pt_3 = Point(Point(-404.5288848, -329.2783032, 1179.291664))

domain = Domain(Domain(0, 360))
panel = Panel(ros_connect.Is_connected)
python = GhPythonScript(domain=domain, increment=Slider(0.5, range=0.5..20), start=Button(), stop=Button(), reset=Button(), loop=Toggle(True))  # -> out, number
# ---------- python: Python ----------
from scriptcontext import sticky as st
from compas_fab.ghpython.components import create_id
from compas_ghpython import update_component

counter_key = create_id(ghenv.Component, 'counter')
running_key = create_id(ghenv.Component, 'running')

start_value, stop_value = domain

if counter_key not in st or reset:
    st[counter_key] = start_value
    st[running_key] = False

if start: 
    st[running_key] = True

if stop: 
    st[running_key] = False

if st[running_key]:
    if st[counter_key] < stop_value:
        st[counter_key] += increment
        update_component(ghenv, 1)
    else:
        if loop:
            st[counter_key] -= stop_value
            update_component(ghenv, 1)
        else:
            st[running_key] = False

number = st[counter_key]
# ---------- end python ----------
pt_4 = Point([pt_2, pt_3, pt])
panel_2 = Panel(python.number)
rad = Radians(Degrees=python.number)
pt_5 = ConstructPoint(XCoordinate=0, YCoordinate=0, ZCoordinate=Slider(994, range=800..3000))
xy = XYPlane(Origin=pt_4)
pt_6 = Point(pt_5)
python_2 = GhPythonScript(client=ros_connect.Ros_client, topic_name="/camera_pose", message_type="geometry_msgs/PoseStamped", advertise=Button())  # -> topic
# ---------- python_2: Python ----------
from roslibpy import Topic

topic = Topic(client, topic_name, message_type)

if advertise:
    topic.advertise()
# ---------- end python_2 ----------
python_3 = GhPythonScript(client=ros_connect.Ros_client, topic_name="/tree_poses", message_type="geometry_msgs/PoseArray", advertise=Button())  # -> topic; same code as python_2
python_4 = GhPythonScript(target=pt_6, angle=rad, radius=Slider(4518, range=0..10000), z=Slider(330, range=2..5000))  # -> frame
# ---------- python_4: Python ----------
from compas_xr.semiramis.camera_position import camera_position


frame = camera_position(target, angle, radius, z)
# ---------- end python_4 ----------
timer = Timer(TimerInterval=1000, Target=python_5)
python_5 = GhPythonScript(topic=python_3, planes=xy)  # inputs planes: list
# ---------- python_5: Python ----------
import json
from compas.geometry import Frame
from compas_fab.backends.ros.messages import Pose
from compas_xr.semiramis.messages import PoseArray

frames = [Frame(plane.Origin, plane.XAxis, plane.YAxis) for plane in planes]
poses = [Pose.from_frame(frame) for frame in frames]

print PoseArray(poses=poses).msg

topic.publish(PoseArray(poses=poses).msg)
# ---------- end python_5 ----------
publish = GhPythonScript(topic=python_2, frame=python_4)
# ---------- publish: Python ----------
from compas_fab.backends.ros.messages import Pose, PoseStamped

pose_msg = Pose.from_frame(frame)
pose_stamped_msg = PoseStamped(pose=pose_msg)
topic.publish(pose_stamped_msg.msg)
# ---------- end publish ----------
